# Dynamo graph CopyAllParameterValues_p.dyn (Dynamo 1.3.1.1736)

categories = Categories()
all_elements_of_category = ElementsOfCategory(categories)
original_parameter_name = StringInput("")
getParameterValueByName = Element.GetParameterValueByName(element=all_elements_of_category, parameterName=original_parameter_name)
watch = Watch(getParameterValueByName)
návod = StringInput("""Skopiruje hodnoty jedneho parametra vsetkych elementov danej kategorie do zvoleneho noveho parametru.

Vhodné napr. pri zmene Project parametru na Shared parameter, pricom do novovytvoreneho paremetra potrebujeme nakopirovat spravne hodnoty povodneho parametra.

Novy parameter uz musi byt vytvoreny.
""")
new_parameter_name = StringInput("")
setParameterByName = Element.SetParameterByName(element=all_elements_of_category, parameterName=new_parameter_name, value=getParameterValueByName)
count = Count(setParameterByName)
počet_prekopírovaných_hodnôt = Watch(count)
