# Dynamo graph Duplicate views_p.dyn (Dynamo 2.3.0.5885)
# packages: Clockwork for Dynamo 2.x 2.1.2

# group: INPUT
new_floor_plan_parameter_name = StringInput("Delenie I")  # graph input
new_floor_plan_parameter_value = StringInput("nove podorysy")  # graph input
parameter_value = StringInput("1")  # graph input
parameter_name = StringInput("Title on Sheet")  # graph input
copied_view_name_suffix = StringInput("floor")  # graph input

návod = StringInput("""Skopiruje Views (ktore maju priradeny  parameter s nazvom "Parameter Name" s hodnotou "Parameter Value") ako "Duplicate with detailing" a prida nazvu View priponu "Copied View Name Suffix"

Treba doinstalovat Package Clockwork.""")  # graph input
code_block = CodeBlock { "Views"; }
byName = Category.ByName(name=code_block)
all_elements_of_category = ElementsOfCategory(Category=byName)
getParameterValueByName = Element.GetParameterValueByName(element=all_elements_of_category, parameterName=parameter_name)
eq = parameter_value == getParameterValueByName
filterByBoolMask = List.FilterByBoolMask(list=all_elements_of_category, mask=eq)
code_block_2 = CodeBlock { "View Name"; }
getParameterValueByName_2 = Element.GetParameterValueByName(element=filterByBoolMask.in, parameterName=code_block_2)
code_block_3 = CodeBlock(name=getParameterValueByName_2, suffix=copied_view_name_suffix) { name + suffix; }
duplicateWithDetailing = Custom[View.DuplicateWithDetailing](view=filterByBoolMask.in, name=code_block_3)  # package Clockwork for Dynamo 2.x; Duplicates a given view with detailing
vytvorené_views = Watch(duplicateWithDetailing)  # graph output
