# Dynamo graph Room renumbering spline - filter by name_p.dyn (Dynamo 1.3.1.1736)

categories = Categories("Rooms")
all_elements_of_category = ElementsOfCategory(categories)

# group: INPUT
rename_only_rooms_with_name_1 = StringInput("Kobka")
rename_only_rooms_with_name_2 = StringInput("Sklad garáže")
select_model_line = DSModelElementSelection()
code_block = CodeBlock { 800; }
prefix = StringInput("KA")
start_number = DoubleInput(96)

code_block_2 = CodeBlock { "Name"; }
getParameterValueByName = Element.GetParameterValueByName(element=all_elements_of_category, parameterName=code_block_2)
eq = rename_only_rooms_with_name_1 == getParameterValueByName
eq_2 = rename_only_rooms_with_name_2 == getParameterValueByName
xor = Logic.Xor(eq, eq_2)
filterByBoolMask = List.FilterByBoolMask(list=all_elements_of_category, mask=xor)
filterByBoolMask_2 = List.FilterByBoolMask(list=filterByBoolMask.in)  # unwired: mask
watch = Watch(filterByBoolMask_2.in)
# note: chyba v tomto node, znamena ze ciara nie je nakreslena ako MODEL LINE
curve = CurveElement.Curve(select_model_line)
# note: chyba v tomto node znamena ze ciara je prilis dlha
pointsAtChordLengthFromPoint = Curve.PointsAtChordLengthFromPoint(curve, arg2=code_block)
splitByPoints = Curve.SplitByPoints(curve=curve, points=pointsAtChordLengthFromPoint)
endPoint = Curve.EndPoint(splitByPoints)
boundingBox = Geometry.BoundingBox(filterByBoolMask.in)
contains = BoundingBox.Contains(boundingBox)  # unwired: arg1
map = List.Map(list=endPoint, f_x=contains)
map_2 = List.Map(list=map, f_x=filterByBoolMask_2.in)
flatten = Flatten(map_2)
uniqueItems = List.UniqueItems(flatten)
watch_2 = Watch(uniqueItems)
string = StringInput("Number")
count = Count(watch_2)
number = DoubleInput(1)
sequence = Sequence(start=start_number, amount=count, step=number, lacing=Longest)

# group: 0 navyse pri jednocifernych cislach
number_2 = DoubleInput(10)
lt = sequence < number_2
number_3 = DoubleInput(0)
code_block_3 = CodeBlock { ""; }
if_ = If(test=lt, true=number_3, false=code_block_3)

# group: 0 navyse pri dvojcifernych cislach
number_4 = DoubleInput(100)
lt_2 = sequence < number_4
number_5 = DoubleInput(0)
code_block_4 = CodeBlock { ""; }
if_2 = If(test=lt_2, true=number_5, false=code_block_4)

string_from_object = FromObject(sequence)
code_block_5 = CodeBlock(x=prefix, c=if_, y=if_2, d=string_from_object) { x+c+y+d; }
setParameterByName = Element.SetParameterByName(element=watch_2, parameterName=string, value=code_block_5)
count_2 = Count(setParameterByName)
počet_premenovaných_miestností = Watch(count_2)
návod = StringInput("""Format precislovania = p.mmm
p=prefix, m=cislo miestnosti
napr. = KA.156

Precisluje vsetky miestnosti vyhovujúce filtru podla nakreslenej ciary.
 Najprv je potrebne nakreslit ciaru (najlepsie spline), ktora pretina miestnosti ktore chceme precislovat. Ciary je dobre robit v samostatnej Subcategory napr. "Renumbering rooms" aby sa dali lahko vsetky naraz vypnut/zapnut pre nasledne opatovne precislovanie. Ciara musi byt kreslena ako Model Line alebo convertovana z Detail Line.
 Model Line musi byt nakreslena vo Workplane, ktora pretina precislovane miestnost, cize typicky v rovine podlahy. Pri velmi dlhej ciare sa moze vyskytnut chyba, vtedy rozdelte ciaru na viacere elementy.
 Prikaz moze pracovat dlhsie, nepustajte ho v automatickom mode, ale len v manualnom.""")
