# Dynamo graph architectural floor from room perimeter_p.dyn (Dynamo 2.3.0.5885)

# group: INPUT
# note: Place inputs for Dynamo Player

# group: Filter
# note: filtering elements

# group: Error handling
# note: Treating errors as hints to user what to do to avoid the error

# group: OUTPUT
# note: Place output for Dynamo Player

# group: INPUT
levels = Levels("Level 1")  # graph input
floortype_by_rooms_floorfinish = BoolSelector(true)  # graph input
placeholder_floor_type_only_if = FloorTypes("Floor 1")  # "Placeholder Floor Type (Only if not by Room's Floor Finish)"; graph input
návod = StringInput("""Vytvori architectural floor podla Floor Finish prislusnej miestnosti. Je potrebne vytvorit Floor types s nazvom zhodnym s Floor Finish. Floor sa vytvorí v rovine Levelu, na ktorom je miestnost umiestnena.

Ak nemáte vytvorené Floor types je možné nastaviť aj vytváranie placeholder dosiek.""")  # graph input

# group: Filtering Rooms By Level
all_elements_at_level = ElementsAtLevel(Level=levels)
code_block = CodeBlock { "Rooms"; }
byName = Category.ByName(name=code_block)
string_from_object = FromObject(obj=byName)
getCategory = Element.GetCategory(element=all_elements_at_level)
string_from_object_2 = FromObject(obj=getCategory)
eq = string_from_object == string_from_object_2

filterByBoolMask = List.FilterByBoolMask(list=all_elements_at_level, mask=eq)
watch = Watch(filterByBoolMask.in)
geometry = Element.Geometry(element=filterByBoolMask.in)
flatten = List.Flatten(list=geometry)
XY = Plane.XY()
elevation = Level.Elevation(level=levels)
code_block_2 = CodeBlock(a=elevation) { a+100; }
offset = Plane.Offset(plane=XY, dist=code_block_2)
intersect = Geometry.Intersect(geometry=flatten, other=offset)
flatten_2 = List.Flatten(list=intersect)
perimeterCurves = Surface.PerimeterCurves(surface=flatten_2)

# group: Floor by Room's Floor Finish
code_block_3 = CodeBlock { "Floor Finish"; }
getParameterValueByName = Element.GetParameterValueByName(element=filterByBoolMask.in, parameterName=code_block_3)
byName_2 = FloorType.ByName(name=getParameterValueByName)

pyIF = Python(IN[0]=floortype_by_rooms_floorfinish, IN[1]=byName_2, IN[2]=placeholder_floor_type_only_if)
# ---------- pyIF.python (20 lines) ----------
# Load the Python Standard and DesignScript Libraries
import sys
import clr
clr.AddReference('ProtoGeometry')
from Autodesk.DesignScript.Geometry import *

# The inputs to this node will be stored as a list in the IN variables.
boolean = IN[0]
true = IN[1]
false = IN[2]

# Place your code below this line
if boolean == 1:
	result = true
elif boolean == 0:
	result = false
else:
	result = null
# Assign your output to the OUT variable.
OUT = result
# ----------------------------------------
byOutlineTypeAndLevel = Floor.ByOutlineTypeAndLevel(outlineCurves=perimeterCurves, floorType=pyIF, level=levels)
count = List.Count(list=byOutlineTypeAndLevel)

# group: OUTPUT
počet_vytvorených_floors = Watch(count)  # graph output

py_log = Python()  # unwired: IN[0]
# ---------- py_log.python (37 lines) ----------
# Load the Python Standard and DesignScript Libraries
import sys
import clr
clr.AddReference('ProtoGeometry')
from Autodesk.DesignScript.Geometry import *
clr.AddReference("RevitServices")
import RevitServices
from RevitServices.Persistence import DocumentManager

from datetime import datetime
import getpass

# name of the script for log
log_string = "architectural floor from room perimeter_p.dyn"

doc = DocumentManager.Instance.CurrentDBDocument
filePath = doc.PathName

# getting file name from path
lastBackslash = filePath.rindex("\\")+1
file_name = filePath[lastBackslash:]
user_name = getpass.getuser()
datestamp = str(datetime.now())
# tabulator between data to easy import to excel schedule
separator = "\t"
line = datestamp + separator + log_string + separator + user_name + "\n"

try:
	f = open("L:\\customToolslogs\\dynLogs\\" + file_name +".log", "a")
	f.write(line)
	f.close()
	status = "log has been written"
except:
	status = "something went wrong"

# Assign your output to the OUT variable.
OUT = status
# ----------------------------------------
