# Dynamo graph door_flip_setter_p.dyn (Dynamo 1.3.2.2480)

categories = Categories("Doors")
all_elements_of_category = ElementsOfCategory(categories)

# group: INPUT
select_phase = RevitPhases()
parameter_name = StringInput("Door Swing")

door_set_handing = Custom[Door Set Handing](Door_s=all_elements_of_category, Phase=select_phase)  # Determines door set handing (whether its a left or right handed door). Input takes doors, and output will split them into two lists (right and left).
watch = Watch(door_set_handing.Right_Handed_Reversed)
návod = StringInput("Všetkým dverám v projekte zapise do parametru urcenom v \"Parameter Name\" značku P resp. L podľa toho či sú ľavé či oravé\n\nJe potrebne doinstalovat Package \"Achi-lab\"")
code_block = CodeBlock { "P"; }
setParameterByName = Element.SetParameterByName(element=door_set_handing.Right_Handed, parameterName=parameter_name, value=code_block)
count = Count(setParameterByName)
code_block_2 = CodeBlock { "L"; }
setParameterByName_2 = Element.SetParameterByName(element=door_set_handing.Left_Handed, parameterName=parameter_name, value=code_block_2)
count_2 = Count(setParameterByName_2)
code_block_3 = CodeBlock { "L"; }
setParameterByName_3 = Element.SetParameterByName(element=door_set_handing.Right_Handed_Reversed, parameterName=parameter_name, value=code_block_3)
count_3 = Count(setParameterByName_3)
code_block_4 = CodeBlock { "P"; }
setParameterByName_4 = Element.SetParameterByName(element=door_set_handing.Left_Handed_Reversed, parameterName=parameter_name, value=code_block_4)
count_4 = Count(setParameterByName_4)
code_block_5 = CodeBlock(a=count, b=count_2, c=count_3, d=count_4) { a+b+c+d; }
počet_upravených_dverí = Watch(code_block_5)
