# Dynamo graph prierazyRectDucts&cableTrays_p.dyn (Dynamo 2.0.1.5055)

# group: INPUT
select_wall = DSModelElementSelection()  # 1 picked in the model; graph input
select_ducts_and_cable_trays = DSModelElementsSelection()  # 1 picked in the model; graph input
o_koľko_má_byť_väčší_otvor_na = DoubleSlider(50, range=0..200 step 10)  # "o koľko má byť väčší otvor na každú stranu"; graph input
rozmer_otvorov_zaokrúliť_na = DoubleSlider(10, range=0..100 step 10)  # graph input
kód_profesie = StringInput("VZ")  # graph input

# group: Opening Family Type
code_block = CodeBlock { "Prieraz_RECT_stena"; }
byName = FamilyType.ByName(name=code_block)
family_prierazu = FamilyTypes(index=33)

geometry = Element.Geometry(element=select_wall)
location = Custom[Element.Location+](element=select_ducts_and_cable_trays)  # Returns the location of an element as point, curve or curve loop, along with some booleans to help filtering the results. Unlike the OOTB Element.GetLocation node, it also retunrs sketch lines of sketch-based elements like floor slabs as well as the element's rotation property.
intersect = Geometry.Intersect(geometry=geometry, other=location.curves, lacing=CrossProduct)
flatten = List.Flatten(list=intersect)
endPoint = Curve.EndPoint(curve=flatten)
code_block_2 = CodeBlock(a=o_koľko_má_byť_väčší_otvor_na) { a*2; }

# group: Calculates opening height
code_block_3 = CodeBlock { "Height"; }
getParameterValueByName = Element.GetParameterValueByName(element=select_ducts_and_cable_trays, parameterName=code_block_3)
code_block_4 = CodeBlock(parameter=getParameterValueByName, offset=code_block_2) { parameter + offset; }
ceiling = Custom[Rounding.Ceiling+](dbl=code_block_4, precision=rozmer_otvorov_zaokrúliť_na)  # Rounds a number *up* to a specified precision

# group: lowering basepoint because of origin on bottom edge
X = Point.X(point=endPoint)
Y = Point.Y(point=endPoint)
Z = Point.Z(point=endPoint)
code_block_5 = CodeBlock(z=Z, height=ceiling) { z-height/2; }
byCoordinates = Point.ByCoordinates(x=X, y=Y, z=code_block_5)

byPoints = Custom[Springs.HostedInstance.ByPoints](host=select_wall, type=byName, point=byCoordinates)  # Creates hosted family instances(doors/windows) at the specified points. You can feed either a single family type or a unique type for each instance.

# group: Calculates opening width
code_block_6 = CodeBlock { "Width"; }
getParameterValueByName_2 = Element.GetParameterValueByName(element=select_ducts_and_cable_trays, parameterName=code_block_6)
code_block_7 = CodeBlock(parameter=getParameterValueByName_2, offset=code_block_2) { parameter + offset; }
ceiling_2 = Custom[Rounding.Ceiling+](dbl=code_block_7, precision=rozmer_otvorov_zaokrúliť_na)

# group: set opening width
setParameterByName = Element.SetParameterByName(element=byPoints, parameterName=code_block_6, value=ceiling_2)

# group: set opening heigth
setParameterByName_2 = Element.SetParameterByName(element=byPoints, parameterName=code_block_3, value=ceiling)

parameter_name = StringInput("Profesia")

# group: setter - profesia
setParameterByName_3 = Element.SetParameterByName(element=byPoints, parameterName=parameter_name, value=kód_profesie)

návod = StringInput("""Vo vybranej stene vytvorí automaticky prierazy pre vybrané VZT potrubia obdĺžnikového prierezu - Duct alebo káblové žľaby - Cable Trays. V projekte musí byť naloadovaná family s názvom "Prieraz_RECT_stena" a pridaný Shared Parameter "Profesia".

Trasy profesií je potrebné dočasne nakopírovať priamo do projektu. Nestačí mať naloadovaný link.

Je potrebné mať nainštalované packages Clockwork a Springs""")  # graph input
