# Dynamo graph revision cloud comments schedule ALL_p.dyn (Dynamo 1.3.1.1736)

categories = Categories("RevisionClouds")
all_elements_of_category = ElementsOfCategory(categories)
code_block = CodeBlock { "Comments"; }
getParameterValueByName = Element.GetParameterValueByName(element=all_elements_of_category, parameterName=code_block)
watch = Watch(getParameterValueByName)

# group: INPUT
# note: Vytvori zoznam vsetkych Revision Clouds s priradenym Comments vo forme tabulky, ktoru vyexportuje do formatu *.xls aj s ID daneho Revision Cloudu. V Revite potom Revision cloud najdeme pomocou Manage/Inquiry/Select by ID
file_path = Filename("C:\Users\davidv\Documents\rev.xlsx")

code_block_2 = CodeBlock { "sheet"; 0; }
id = Element.Id(all_elements_of_category)
create = List.Create(getParameterValueByName, id)
transpose = List.Transpose(create)
boolean = BoolSelector(true)
writeToFile = Excel.WriteToFile(filePath=file_path, sheetName=code_block_2.out0, startRow=code_block_2.out1, startCol=code_block_2.out1, data=transpose, overWrite=boolean)
návod = StringInput("Vytvori zoznam vsetkych Revision Clouds s priradenym Comments vo forme tabulky, ktoru vyexportuje do formatu *.xls aj s ID daneho Revision Cloudu. V Revite potom Revision cloud najdeme pomocou Manage/Inquiry/Select by ID")
