# Dynamo graph revision cloud comments schedule FILTER_p.dyn (Dynamo 2.0.1.5055)

categories = Categories(index=395)
all_elements_of_category = ElementsOfCategory(Category=categories)
code_block = CodeBlock { "Revision Description"; }
getParameterValueByName = Element.GetParameterValueByName(element=all_elements_of_category, parameterName=code_block)

# group: INPUT
filter_by_revision_description = StringInput("STENY VÝŤAHOVÝCH ŠÁCHT")  # graph input
file_path = Filename("C:\Users\davidv\Documents\rev.xls")  # graph input

eq = getParameterValueByName == filter_by_revision_description
filterByBoolMask = List.FilterByBoolMask(list=all_elements_of_category, mask=eq)
code_block_2 = CodeBlock { "Comments"; }
getParameterValueByName_2 = Element.GetParameterValueByName(element=filterByBoolMask.in, parameterName=code_block_2)
watch = Watch(getParameterValueByName_2)
code_block_3 = CodeBlock { "sheet"; 0; }
id = Element.Id(element=filterByBoolMask.in)
getParameterValueByName_3 = Element.GetParameterValueByName(element=filterByBoolMask.in, parameterName=code_block)
create = List.Create(item0=getParameterValueByName_2, item1=id, item2=getParameterValueByName_3)
transpose = List.Transpose(lists=create)
boolean = BoolSelector(true)
exportExcel = Data.ExportExcel(filePath=file_path, sheetName=code_block_3.out0, startRow=code_block_3.out1, startCol=code_block_3.out1, data=transpose, overWrite=boolean)
návod = StringInput("Vytvori zoznam vsetkych Revision Clouds s priradenym Comments vo forme tabulky, ktoru vyexportuje do formatu *.xls aj s ID daneho Revision Cloudu a Revision Description. Filtruje na zaklade Revision Description. V Revite potom Revision cloud najdeme pomocou Manage/Inquiry/Select by ID")  # graph input
