# Dynamo graph sheets upper case.dyn (Dynamo 0.9.2.4472)

categories = Categories("Sheets")
all_elements_of_category = ElementsOfCategory(categories)

# group: INPUT
# note: Zmeni velkost pisma na VELKE v nazve Sheetov.
# Sheety vyfiltruje podla zadaneho parametra. Ak je potrebne zmenit velkost pisma vo vsetkych Sheetoch, INPUT node "Search for" zostane nevyplneny
filter_by_parameter = CodeBlock { "Approved By"; }
search_for = CodeBlock { "Výpis"; }

getParameterValueByName = Element.GetParameterValueByName(element=all_elements_of_category, parameterName=filter_by_parameter)
contains = String.Contains(str=getParameterValueByName, searchFor=search_for)
filterByBoolMask = List.FilterByBoolMask(list=all_elements_of_category, mask=contains)
code_block = CodeBlock { "Sheet Name"; }
getParameterValueByName_2 = Element.GetParameterValueByName(element=filterByBoolMask.in, parameterName=code_block)
toUpper = String.ToUpper(getParameterValueByName_2)
setParameterByName = Element.SetParameterByName(element=filterByBoolMask.in, parameterName=code_block, value=toUpper)
