# Dynamo graph spline2segments_p.dyn (Dynamo 1.3.2.2480)

návod = StringInput("vytvorí nasegmentované steny alebo Curtain Walls podľa krivky s voliteľnou dĺžkou segmentu")

# group: INPUT
select_model_line = DSModelElementSelection()
segment_length = DoubleSlider(7000, range=200..8000 step 50)

curve = CurveElement.Curve(select_model_line)
pointsAtChordLengthFromPoint = Curve.PointsAtChordLengthFromPoint(curve, arg2=segment_length)
splitByPoints = Curve.SplitByPoints(curve=curve, points=pointsAtChordLengthFromPoint)
watch = Watch(splitByPoints)
startPoint = Curve.StartPoint(splitByPoints)
endPoint = Curve.EndPoint(splitByPoints)
byStartPointEndPoint = Line.ByStartPointEndPoint(startPoint=startPoint, endPoint=endPoint)
byCurve = ModelCurve.ByCurve(byStartPointEndPoint)
vytvorené_segmenty = Watch(byCurve)
