# Dynamo graph subregion2filledRegion_p.dyn (Dynamo 1.3.2.2480)

# group: INPUT
select_element = DSModelElementSelection()
select_filled_region_type = FilledRegionTypes("Betón")

boolean = BoolSelector(true)
elementSketch = Custom[Springs.Collector.ElementSketch](element=select_element, fetchModelCurves=boolean)  # Get the actual sketch lines of a sketch based element (floor, ceiling, modified wall, etc.) . You can optionally fetch the matching model curves, however this might prove comptationally heavy on larger data sets.
flatten = Flatten(elementSketch.model_curves)
current = Document.Current()
activeView = Document.ActiveView(current)
curve = CurveElement.Curve(elementSketch.model_curves)
byCurves = FilledRegion.ByCurves(activeView, curve, select_filled_region_type)
návod = StringInput("Skopíruje Sketchlines zo sketch based elementov ako Floor, Subregion, Roof atd a nakresli podla nich Filled region v aktivnom View")
